# Grasshopper definition assignment01_Maze.gh (Grasshopper 1.0.7)
# plug-ins: Hops

hops = Hops(
    WAndHCount=Slider(17, range=0..100),
    Thickness=Slider(0.2, range=0..1),
    SeedNumber=Slider(24, range=0..100),
    CacheResultsInMemory=True,
    CacheSolveResults=True,
    RemoteDefinitionLocation="C:\Users\juman\Downloads\maze with contextual.gh",
    RemoteSolveVersion=(0, 1, 0),
    ShowInput_Enabled=False,
    ShowInput_Path=False,
    SynchronousSolve=True)
