# Grasshopper definition assignment01_Maze_Hops.gh (Grasshopper 1.0.7)
# plug-ins: Hops

hops = Hops(
    WAndHCount=Slider(19, range=0..100),
    SeedNumber=Slider(0.3, range=0..1),
    Thickness=Slider(0.2, range=0..1),
    CacheResultsInMemory=True,
    CacheSolveResults=True,
    RemoteDefinitionLocation="https://github.com/JumanaHamdani/bimsc21-datamgmt/blob/main/assignment01_maze%20with%20contextual.gh?raw=true",
    RemoteSolveVersion=(0, 1, 0),
    ShowInput_Enabled=False,
    ShowInput_Path=False,
    SynchronousSolve=True)
