# Grasshopper definition assignment01_maze with contextual.gh (Grasshopper 1.0.7)
# plug-ins: Parakeet, Fattener

seed_number = GetNumber(Slider(58, range=0..100), AtLeast=1, AtMost=1, Maximum=1.797693135e+308, Minimum=-1.797693135e+308)
w_and_h_count = GetNumber(Slider(19, range=0..40), AtLeast=1, AtMost=1, Maximum=1.797693135e+308, Minimum=-1.797693135e+308)
mesh_plane = MeshPlane(
    Boundary={Plane=PlaneXY(0, 0, 0), Size=Domain2(u=-10..10, v=-10..10)},
    WidthCount=w_and_h_count,
    HeightCount=w_and_h_count)  # -> Mesh, Area
maze = Maze(Mesh=mesh_plane.Mesh, Seed=seed_number)
thickness = GetNumber(Slider(0.2, range=0..1), AtLeast=1, AtMost=1, Maximum=1.797693135e+308, Minimum=-1.797693135e+308)
fatten = Fatten(Skeleton=maze, Thickness=thickness, LengthSubdivisions=0, EndType=2, AdjustForAngle=False)
mesh = Mesh(fatten)
deconstruct_mesh = DeconstructMesh(Mesh=mesh)  # -> Vertices, Faces, Colours, Normals
deconstruct = Deconstruct(Point=deconstruct_mesh.Vertices)  # -> XComponent, YComponent, ZComponent
bounds = Bounds(Numbers=deconstruct.XComponent)
deconstruct_domain = DeconstructDomain(Domain=bounds)  # -> Start, End
gradient = Gradient(
    LowerLimit=deconstruct_domain.Start,
    UpperLimit=deconstruct_domain.End,
    Parameter=deconstruct.XComponent,
    stops=[0.0902: RGB(252, 198, 0), 0.501: RGB(181, 222, 35), 0.944: RGB(20, 235, 255)])
construct_mesh = ConstructMesh(Vertices=deconstruct_mesh.Vertices, Faces=deconstruct_mesh.Faces, Colours=gradient)
mesh_2 = Mesh(construct_mesh)
context_bake = ContextBake(Geometry=mesh_2)
